# Grasshopper definition Server.gh (Grasshopper 1.0.7)
# plug-ins: RabbitMQ.GH

panel = Panel("SomeDataFrom gh2")

# ----
# Message generation
python = GhPythonScript()  # -> out, message
# ---------- python: Python ----------
import rhinoscriptsyntax as rs
import random

x = random.randint(1, 6)
y = random.randint(1, 6)
z = random.randint(1, 6)
message = "{},{},{}".format(x,y,z)
# ---------- end python ----------

# ----
# Producer setup
message_body = Panel("4")
queue_name = Panel("request_queue")
host_name = Panel("localhost")
boolean_toggle = BooleanToggle(False)
producer = Producer(Run=boolean_toggle, Host=host_name, Queue=queue_name)

server = Server(
    Run=Toggle(False),
    Host="rq.desfab.xyz",
    Port=Slider(8432, range=0..10000),
    Exchange="request_exchange",
    RoutingKeys="request_queue")
server_2 = Server(Run=boolean_toggle, Host=host_name, RoutingKeys=queue_name)
panel_2 = Panel(server)
